% Simulink data dictionary posloop.sldd

ia = Simulink.Signal(StorageClass="ExportedGlobal", DataType="single")
ic = Simulink.Signal(StorageClass="ExportedGlobal", DataType="single")
ib = Simulink.Signal(StorageClass="ExportedGlobal", DataType="single")
ialpha = Simulink.Signal(StorageClass="ExportedGlobal", DataType="single")
ibeta = Simulink.Signal(StorageClass="ExportedGlobal", DataType="single")
id = Simulink.Signal(StorageClass="ExportedGlobal", DataType="single")
iq = Simulink.Signal(StorageClass="ExportedGlobal", DataType="single")
Udc = Simulink.Parameter(24, DataType="single")
Ke = Simulink.Parameter(3.59, StorageClass="Struct", StructName="motor", DataType="single")
L = Simulink.Parameter(8.0e-5, StorageClass="Struct", StructName="motor", DataType="single")
Rs = Simulink.Parameter(0.23, StorageClass="Struct", StructName="motor", DataType="single")
Pn = Simulink.Parameter(4, StorageClass="Struct", StructName="motor", DataType="single")
CurrKi = Simulink.Parameter(2.3, StorageClass="Struct", StructName="CurrKPKI", DataType="single")
CurrKp = Simulink.Parameter(0.0008, StorageClass="Struct", StructName="CurrKPKI", DataType="single")
spd_kp = Simulink.Parameter(0.013, StorageClass="Struct", StructName="spd_kpki", DataType="single")
spd_ki = Simulink.Parameter(0.021, StorageClass="Struct", StructName="spd_kpki", DataType="single")
SpeedFd = Simulink.Signal(StorageClass="ExportedGlobal", DataType="single")
Motor_state = Simulink.Signal(StorageClass="ExportedGlobal", DataType="single")
PosFd = Simulink.Signal(StorageClass="ExportedGlobal", DataType="single")